# Grasshopper definition ColorReader.gh (Grasshopper 1.0.7)

# ---- group: INPUTS
building_geo = Geometry(<brep referenced from the Rhino model>)
context_geo = Geometry([<brep referenced from the Rhino model> x5])
boxes_color = ColourSwatch(SwatchColor=RGB(0, 0, 0))
save = Button()

# ---- group: TARGET PATH
path = FilePath("E:\GitRepo\pix2pix_CAADRIA\Pix2Pix_Project\generate\source")

# ---- group: READ IMAGES
preview_size = Slider(0.2, range=0..1)
path_2 = FilePath(["E:\GitRepo\pix2pix_CAADRIA\Pix2Pix_Project\generate\result\level 0.jpg", "E:\GitRepo\pix2pix_CAADRIA\Pix2Pix_Project\generate\result\level 1.jpg", "E:\GitRepo\pix2pix_CAADRIA\Pix2Pix_Project\generate\result\level 2.jpg", "E:\GitRepo\pix2pix_CAADRIA\Pix2Pix_Project\generate\result\level 3.jpg", "E:\GitRepo\pix2pix_CAADRIA\Pix2Pix_Project\generate\result\level 4.jpg", "E:\GitRepo\pix2pix_CAADRIA\Pix2Pix_Project\generate\result\level 5.jpg", "E:\GitRepo\pix2pix_CAADRIA\Pix2Pix_Project\generate\result\level 6.jpg", "E:\GitRepo\pix2pix_CAADRIA\Pix2Pix_Project\generate\result\level 7.jpg", "E:\GitRepo\pix2pix_CAADRIA\Pix2Pix_Project\generate\result\level 8.jpg", "E:\GitRepo\pix2pix_CAADRIA\Pix2Pix_Project\generate\result\level 9.jpg", "E:\GitRepo\pix2pix_CAADRIA\Pix2Pix_Project\generate\result\level 10.jpg", "E:\GitRepo\pix2pix_CAADRIA\Pix2Pix_Project\generate\result\level 11.jpg", "E:\GitRepo\pix2pix_CAADRIA\Pix2Pix_Project\generate\result\level 12.jpg", "E:\GitRepo\pix2pix_CAADRIA\Pix2Pix_Project\generate\result\level 13.jpg", "E:\GitRepo\pix2pix_CAADRIA\Pix2Pix_Project\generate\result\level 14.jpg", "E:\GitRepo\pix2pix_CAADRIA\Pix2Pix_Project\generate\result\level 15.jpg", "E:\GitRepo\pix2pix_CAADRIA\Pix2Pix_Project\generate\result\level 16.jpg", "E:\GitRepo\pix2pix_CAADRIA\Pix2Pix_Project\generate\result\level 17.jpg", "E:\GitRepo\pix2pix_CAADRIA\Pix2Pix_Project\generate\result\level 18.jpg", "E:\GitRepo\pix2pix_CAADRIA\Pix2Pix_Project\generate\result\level 19.jpg", "E:\GitRepo\pix2pix_CAADRIA\Pix2Pix_Project\generate\result\level 20.jpg", "E:\GitRepo\pix2pix_CAADRIA\Pix2Pix_Project\generate\result\level 21.jpg", "E:\GitRepo\pix2pix_CAADRIA\Pix2Pix_Project\generate\result\level 22.jpg", "E:\GitRepo\pix2pix_CAADRIA\Pix2Pix_Project\generate\result\level 23.jpg"])
c_script = CSharpScript(imagesPaths=path_2)  # -> out, points; inputs imagesPaths: list of String
# ---------- c_script: C# usings ----------
using System.Drawing;
using System.IO;
# ---------- c_script: C# ----------
    List<Point3d> generatedPoints = new List<Point3d>();
    Print(Color.White.ToString());
    for (int i = 0; i < imagesPaths.Count; i++)
    {
      string path = imagesPaths[i];
      Bitmap img = new Bitmap(path);

      for (int x = 0; x < img.Size.Width; x++)
      {
        for (int y = 0; y < img.Size.Height; y++)
        {
          var pix = img.GetPixel(x, y);
          bool r = pix.R < 60;
          bool g = pix.G < 60;
          bool b = pix.B < 60;
          if (r && g && b)
          {

            Point3d newPoint = new Point3d(x, y, i);
            generatedPoints.Add(newPoint);
          }
        }
      }
    }
    points = generatedPoints;
# ---------- end c_script ----------
box = CenterBox(Base=c_script.points, X=preview_size, Y=preview_size, Z=preview_size)
Z = UnitZ(Factor=preview_size)
move = Move(Geometry=box, Motion=Z)  # -> Geometry, Transform

# ---- group: VOXELIZER - BUILDING
bbox = BoundingBox(Content=building_geo, Plane=PlaneXY(0, 0, 0))  # -> Box, Box_2
debox = DeconstructBox(Box=bbox.Box)  # -> Plane, X, Y, Z
dedomain = DeconstructDomain(Domain=debox.Y)  # -> Start, End
dedomain_2 = DeconstructDomain(Domain=debox.Z)  # -> Start, End
dedomain_3 = DeconstructDomain(Domain=debox.X)  # -> Start, End
subtraction = Subtraction(A=dedomain.End, B=dedomain.Start)
subtraction_2 = Subtraction(A=dedomain_2.End, B=dedomain_2.Start)
subtraction_3 = Subtraction(A=dedomain_3.End, B=dedomain_3.Start)
lng = ListLength(List=bbox.Box)
pt = ConstructPoint(XCoordinate=dedomain_3.Start, YCoordinate=dedomain.Start, ZCoordinate=dedomain_2.Start)
X = UnitX(Factor=1)
larger = LargerThan(FirstNumber=lng, SecondNumber=1)  # -> LargerThan, OrEqualTo
arrlinear = LinearArray(Geometry=pt, Direction=X, Count=subtraction_3)  # -> simplify(Geometry), Transform
Y = UnitY(Factor=1)
python = GhPythonScript(x=larger.LargerThan)  # -> a
# ---------- python: Python ----------
if x:
    a = 1
else:
    a = 0
# ---------- end python ----------
arrlinear_2 = LinearArray(Geometry=arrlinear.Geometry, Direction=Y, Count=graft(subtraction))  # -> simplify(Geometry), Transform
Z_2 = UnitZ(Factor=1)
trim = TrimTree(Tree=arrlinear_2.Geometry, Depth=python)
arrlinear_3 = LinearArray(Geometry=trim, Direction=Z_2, Count=graft(subtraction_2))  # -> Geometry, Transform
brepinc = PointInBrep(Brep=building_geo, Point=arrlinear_3.Geometry, Strict=False)
dispatch = Dispatch(List=arrlinear_3.Geometry, DispatchPattern=brepinc)  # -> ListA, ListB
clean = CleanTree(RemoveNulls=True, RemoveInvalid=True, RemoveEmpty=True, Tree=dispatch.ListA)  # -> flatten(Tree)

# ---- group: VOXELIZER - CONTEXT
bbox_2 = BoundingBox(Content=context_geo, Plane=PlaneXY(0, 0, 0))  # -> Box, Box_2
debox_2 = DeconstructBox(Box=bbox_2.Box)  # -> Plane, X, Y, Z
dedomain_4 = DeconstructDomain(Domain=debox_2.Y)  # -> Start, End
dedomain_5 = DeconstructDomain(Domain=debox_2.Z)  # -> Start, End
dedomain_6 = DeconstructDomain(Domain=debox_2.X)  # -> Start, End
subtraction_4 = Subtraction(A=dedomain_4.End, B=dedomain_4.Start)
subtraction_5 = Subtraction(A=dedomain_5.End, B=dedomain_5.Start)
subtraction_6 = Subtraction(A=dedomain_6.End, B=dedomain_6.Start)
lng_2 = ListLength(List=bbox_2.Box)
pt_2 = ConstructPoint(XCoordinate=dedomain_6.Start, YCoordinate=dedomain_4.Start, ZCoordinate=dedomain_5.Start)
X_2 = UnitX(Factor=1)
larger_2 = LargerThan(FirstNumber=lng_2, SecondNumber=1)  # -> LargerThan, OrEqualTo
arrlinear_4 = LinearArray(Geometry=pt_2, Direction=X_2, Count=subtraction_6)  # -> simplify(Geometry), Transform
Y_2 = UnitY(Factor=1)
python_2 = GhPythonScript(x=larger_2.LargerThan)  # -> a; same code as python
arrlinear_5 = LinearArray(Geometry=arrlinear_4.Geometry, Direction=Y_2, Count=graft(subtraction_4))  # -> simplify(Geometry), Transform
Z_3 = UnitZ(Factor=1)
trim_2 = TrimTree(Tree=arrlinear_5.Geometry, Depth=python_2)
arrlinear_6 = LinearArray(Geometry=trim_2, Direction=Z_3, Count=graft(subtraction_5))  # -> flatten(Geometry), Transform

# ---- group: CONTEXT GRADIENT
merge = Merge(Data1=dedomain_5.End, Data2=dedomain_2.End)
sort = SortList(Keys=merge)  # -> reverse(Keys), ValuesA
item = ListItem(List=sort.Keys, Index=0, Wrap=True)
range = Range(Domain=item, Steps=item)
gradient = Gradient(LowerLimit=0, UpperLimit=item, Parameter=range, stops=[0: RGB(255, 0, 60), 1: RGB(29, 219, 0)])

# ---- group: BUILDING RECTANGULAR BOUDARY VOXELS
pdecon = Deconstruct(Point=clean)  # -> XComponent, YComponent, flatten(ZComponent)
cset = CreateSet(List=flatten(pdecon.ZComponent))  # -> Set, Map
mindex = MemberIndex(Set=pdecon.ZComponent, Member=cset.Set)  # -> Index, Count
item_2 = ListItem(List=flatten(clean), Index=mindex.Index, Wrap=True)
bbox_3 = BoundingBox(Content=item_2, Plane=PlaneXY(0, 0, 0), UnionBox=True)  # -> Box, Box_2
srf = Surface(bbox_3.Box)
debox_3 = DeconstructBox(Box=bbox_3.Box)  # -> Plane, X, Y, Z
dedomain_7 = DeconstructDomain(Domain=debox_3.Y)  # -> Start, End
dedomain_8 = DeconstructDomain(Domain=debox_3.X)  # -> Start, End
subtraction_7 = Subtraction(A=dedomain_7.End, B=dedomain_7.Start)
subtraction_8 = Subtraction(A=dedomain_8.End, B=dedomain_8.Start)
sdivide = DivideSurface(Surface=srf, UCount=subtraction_8, VCount=subtraction_7)  # -> flatten(Points), Normals, Parameters

# ---- group: SAVE IMAGES
c_script_2 = CSharpScript(
    contextColors=flatten(gradient),
    context=arrlinear_6.Geometry,
    buildingBoxes=sdivide.Points,
    buildingBoxColor=boxes_color,
    path=path,
    run=save)  # -> out, cOut; inputs contextColors: list of Color, context: list of Point3d, buildingBoxes: list of Point3d, buildingBoxColor: Color, path: String, run: Boolean
# ---------- c_script_2: C# ----------
    if(run)
    {
      // Create the bitmaps
      int count = contextColors.Count;
      Bitmap[] images = new Bitmap[count];
      for (int i = 0; i < count; i++)
      {
        images[i] = new Bitmap(256, 256);
        for (int x = 0; x < 256; x++)
        {
          for (int y = 0; y < 256; y++)
          {
            images[i].SetPixel(x, y, Color.White);
          }
        }
      }

      // Read the Context points and assign to the correct image
      foreach(Point3d p in context)
      {
        int x = (int) p.X;
        int y = (int) p.Y;
        int z = (int) p.Z;

        //Print(z.ToString());
        images[z].SetPixel(x, y, contextColors[z]);
      }

      // Read the Building points and assign to the correct image
      List<Point3d> source = buildingBoxes;
      Color c = buildingBoxColor;

      foreach(Point3d p in source)
      {
        int x = Convert.ToInt32(p.X);
        int y = Convert.ToInt32(p.Y);
        int z = Convert.ToInt32(p.Z);

        images[z].SetPixel(x, y, c);
      }


      // Save the image
      for(int i = 0; i < count; i++)
      {
        //string fileName = path + "/level " + i.ToString() + ".png";
        var fileName = Path.Combine(path, "level " + i.ToString() + ".jpg");
        var fStream = File.Create(fileName);
        var img = images[i];
        img.Save(fStream, System.Drawing.Imaging.ImageFormat.Jpeg);
        img.Dispose();
      }
    }
# ---------- end c_script_2 ----------
