# Grasshopper definition ColorWriter.gh (Grasshopper 1.0.7)

c_script = CSharpScript()  # -> out, cOut; inputs planeSize: Int32, contextColors: list of Color, context: list of Point3d, building: list of Point3d, buildingColor: Color, buildingBoxes: list of Point3d, buildingBoxColor: Color, path: String, box: Boolean, run: Boolean
# ---------- c_script: C# usings ----------
using System.Drawing;
using System.Drawing.Imaging;
using System.IO;
using System.Linq;
# ---------- c_script: C# ----------
    if(run)
    {
      // Create the bitmaps
      var layers = building.GroupBy(pt => Convert.ToInt32(Math.Floor(pt.Z)));

      int buildingHeight = layers.Count();

      int count = buildingHeight;

      Bitmap[] images = new Bitmap[count];
      for (int i = 0; i < count; i++)
      {
        images[i] = new Bitmap(planeSize, planeSize);
        for (int x = 0; x < planeSize; x++)
        {
          for (int y = 0; y < planeSize; y++)
          {
            images[i].SetPixel(x, y, Color.White);
          }
        }
      }

      // Read the Context points and assign to the correct image
      foreach(Point3d p in context)
      {
        int x = Convert.ToInt32(Math.Floor(p.X));
        int y = Convert.ToInt32(Math.Floor(p.Y));
        int z = Convert.ToInt32(Math.Floor(p.Z));
        if (z < count) images[z].SetPixel(x, planeSize - y, contextColors[z]);
      }

      // Read the Building points and assign to the correct image
      List<Point3d> source;
      Color c;
      if (box)
      {
        source = buildingBoxes;
        c = buildingBoxColor;
      }
      else
      {
        source = building;
        c = buildingColor;
      }

      foreach(Point3d p in source)
      {
        int x = Convert.ToInt32(Math.Floor(p.X));
        int y = Convert.ToInt32(Math.Floor(p.Y));
        int z = Convert.ToInt32(Math.Floor(p.Z));

        images[z].SetPixel(x, planeSize - y, c);
      }



      // Save the image
      for(int i = 0; i < count; i++)
      {
        //string fileName = path + "/level " + i.ToString() + ".png";
        var fileName = Path.Combine(path, "level " + i.ToString() + ".png");
        var fStream = File.Create(fileName);
        var img = ResizeImage(images[i], 256);
        //var img = images[i];
        img.Save(fStream, System.Drawing.Imaging.ImageFormat.Png);
        img.Dispose();
      }
    }
# ---------- c_script: C# additional code ----------
  private Bitmap ResizeImage(Bitmap image, int size)
  {
    Rectangle destRect = new Rectangle(0, 0, size, size);
    Bitmap destImage = new Bitmap(size, size);
    destImage.SetResolution(image.HorizontalResolution, image.VerticalResolution);

    using (var graphics = Graphics.FromImage(destImage))
    {
      graphics.CompositingMode = System.Drawing.Drawing2D.CompositingMode.SourceCopy;
      graphics.CompositingQuality = System.Drawing.Drawing2D.CompositingQuality.AssumeLinear;
      graphics.InterpolationMode = System.Drawing.Drawing2D.InterpolationMode.NearestNeighbor;
      graphics.SmoothingMode = System.Drawing.Drawing2D.SmoothingMode.HighQuality;
      graphics.PixelOffsetMode = System.Drawing.Drawing2D.PixelOffsetMode.Half;

      graphics.DrawImage(image, destRect, 0, 0, image.Width, image.Height, GraphicsUnit.Pixel);
    }
    return destImage;
  }
# ---------- end c_script ----------
